# Grasshopper definition MainBoardHousing.gh (Grasshopper 0.9.76)

# Mounting Hole Position
pt = Point(Point(0, 0, 0))
multiplication = Multiplication(A="1.40", B=25.4)
X = UnitX(Factor=multiplication)
division = Division(A=multiplication, B=2)
pt_2 = ConstructPoint(XCoordinate=division, YCoordinate=0, ZCoordinate=0)
# Mounting Hole Position
pt_3 = Point(Point(0, 0, 0))
multiplication_2 = Multiplication(A="1.40", B=25.4)
X_2 = UnitX(Factor=multiplication_2)
Z = UnitZ(Factor=1)
division_2 = Division(A=multiplication_2, B=2)
pl = ConstructPlane(Origin=pt_2, XAxis=Vector(1, 0, 0), YAxis=Vector(0, 1, 0))
pl_2 = ConstructPlane(Origin=pt_2, XAxis=Z, YAxis=Vector(0, 1, 0))
multiplication_3 = Multiplication(A="0.05", B=25.4)
multiplication_4 = Multiplication(A="0.15", B=25.4)
circle = CircleCNR(Center=pt, Normal=Vector(0, 0, 1), Radius=multiplication_3)
circle_2 = CircleCNR(Center=pt, Normal=Vector(0, 0, 1), Radius=multiplication_4)
pt_4 = ConstructPoint(XCoordinate=division_2, YCoordinate=0, ZCoordinate=0)
divide = DivideCurve(Curve=circle_2, Count="4", Kinks=False)  # -> Points, Tangents, Parameters
boundary = BoundarySurfaces(Edges=circle)
Z_2 = UnitZ(Factor=1)
bang = ExplodeTree(Data=simplify(graft(divide.Points)))  # -> Branch0, Branch1, Branch2, Branch3
pl_3 = ConstructPlane(Origin=pt_4, XAxis=Vector(1, 0, 0), YAxis=Vector(0, 1, 0))
pl_4 = ConstructPlane(Origin=pt_4, XAxis=Z_2, YAxis=Vector(0, 1, 0))
multiplication_5 = Multiplication(A="0.05", B=25.4)
multiplication_6 = Multiplication(A="0.15", B=25.4)
circle_3 = CircleCNR(Center=pt_3, Normal=Vector(0, 0, 1), Radius=multiplication_5)
circle_4 = CircleCNR(Center=pt_3, Normal=Vector(0, 0, 1), Radius=multiplication_6)
panel = Panel("""-0.2
0.2
-0.1""")
divide_2 = DivideCurve(Curve=circle_4, Count="4", Kinks=False)  # -> Points, Tangents, Parameters
# Box Size
panel_2 = Panel("""1
2.0
1.1""")
boundary_2 = BoundarySurfaces(Edges=circle_3)
panel_3 = Panel("""-0.2
-0.2
+0.2""")
bang_2 = ExplodeTree(Data=simplify(graft(divide_2.Points)))  # -> Branch0, Branch1, Branch2, Branch3
multiplication_7 = Multiplication(A=graft(panel_2), B=25.4)
arc = Arc3Pt(PointA=bang.Branch1, PointB=bang.Branch2, PointC=bang.Branch3)  # -> Arc, Plane, Radius
addition = Addition(A=graft(panel_2), B=graft(panel))
ln = Line(StartPoint=bang.Branch1, EndPoint=bang.Branch3)
rec_3pt = Rectangle3Pt(PointA=bang.Branch1, PointB=bang.Branch3, PointC=bang.Branch0)  # -> Rectangle, Length
addition_2 = Addition(A=graft(panel_2), B=graft(panel_3))
multiplication_8 = Multiplication(A=addition, B=25.4)
bang_3 = ExplodeTree(Data=multiplication_7)  # -> Branch0, Branch1, Branch2
panel_4 = Panel("""-0.2
0.2
-0.1""")
multiplication_9 = Multiplication(A=addition_2, B=25.4)
# Box Size
panel_5 = Panel("""1
2.95
1.2""")
panel_6 = Panel("""-0.2
-0.2
+0.2""")
join = JoinCurves(Curves=[arc.Arc, ln, rec_3pt.Rectangle], Preserve=False)
bang_4 = ExplodeTree(Data=multiplication_8)  # -> Branch0, Branch1, Branch2
bang_5 = ExplodeTree(Data=multiplication_9)  # -> Branch0, Branch1, Branch2
multiplication_10 = Multiplication(A=graft(panel_5), B=25.4)
division_3 = Division(A=bang_3.Branch0, B=2)
division_4 = Division(A=bang_3.Branch1, B=2)
neg = Negative(Value=division_3)
neg_2 = Negative(Value=division_4)
arc_2 = Arc3Pt(PointA=bang_2.Branch1, PointB=bang_2.Branch2, PointC=bang_2.Branch3)  # -> Arc, Plane, Radius
addition_3 = Addition(A=graft(panel_5), B=graft(panel_4))
ln_2 = Line(StartPoint=bang_2.Branch1, EndPoint=bang_2.Branch3)
rec_3pt_2 = Rectangle3Pt(PointA=bang_2.Branch1, PointB=bang_2.Branch3, PointC=bang_2.Branch0)  # -> Rectangle, Length
addition_4 = Addition(A=graft(panel_5), B=graft(panel_6))
boundary_3 = BoundarySurfaces(Edges=join)
division_5 = Division(A=bang_4.Branch0, B=2)
division_6 = Division(A=bang_4.Branch1, B=2)
neg_3 = Negative(Value=division_5)
neg_4 = Negative(Value=division_6)
multiplication_11 = Multiplication(A=addition_3, B=25.4)
division_7 = Division(A=bang_5.Branch0, B=2)
division_8 = Division(A=bang_5.Branch1, B=2)
neg_5 = Negative(Value=division_7)
bang_6 = ExplodeTree(Data=multiplication_10)  # -> Branch0, Branch1, Branch2
neg_6 = Negative(Value=division_8)
multiplication_12 = Multiplication(A=addition_4, B=25.4)
dom = ConstructDomain(DomainStart=division_3, DomainEnd=neg)
dom_2 = ConstructDomain(DomainStart=division_4, DomainEnd=neg_2)
pln = Plane(pl)
join_2 = JoinCurves(Curves=[arc_2.Arc, ln_2, rec_3pt_2.Rectangle], Preserve=False)
sunion = SolidUnion(Breps=boundary_3)
bang_7 = ExplodeTree(Data=multiplication_11)  # -> Branch0, Branch1, Branch2
bang_8 = ExplodeTree(Data=multiplication_12)  # -> Branch0, Branch1, Branch2
dom_3 = ConstructDomain(DomainStart=division_5, DomainEnd=neg_3)
dom_4 = ConstructDomain(DomainStart=division_6, DomainEnd=neg_4)
dom_5 = ConstructDomain(DomainStart=division_7, DomainEnd=neg_5)
dom_6 = ConstructDomain(DomainStart=division_8, DomainEnd=neg_6)
division_9 = Division(A=bang_6.Branch0, B=2)
division_10 = Division(A=bang_6.Branch1, B=2)
neg_7 = Negative(Value=division_9)
neg_8 = Negative(Value=division_10)
num = Number(bang_3.Branch2)
sdiff = SolidDifference(BrepsA=sunion, BrepsB=boundary)
boundary_4 = BoundarySurfaces(Edges=join_2)
division_11 = Division(A=bang_7.Branch0, B=2)
division_12 = Division(A=bang_7.Branch1, B=2)
neg_9 = Negative(Value=division_11)
neg_10 = Negative(Value=division_12)
division_13 = Division(A=bang_8.Branch0, B=2)
division_14 = Division(A=bang_8.Branch1, B=2)
neg_11 = Negative(Value=division_13)
rectangle = Rectangle(Plane=pln, XSize=dom, YSize=dom_2, Radius=0)  # -> Rectangle, Length
neg_12 = Negative(Value=division_14)
mirror = Mirror(Geometry=sdiff, Plane=pl_2)  # -> Geometry, Transform
dom_7 = ConstructDomain(DomainStart=division_9, DomainEnd=neg_7)
dom_8 = ConstructDomain(DomainStart=division_10, DomainEnd=neg_8)
pln_2 = Plane(pl_3)
sunion_2 = SolidUnion(Breps=boundary_4)
rectangle_2 = Rectangle(Plane=pln, XSize=dom_3, YSize=dom_4, Radius=0)  # -> Rectangle, Length
dom_9 = ConstructDomain(DomainStart=division_11, DomainEnd=neg_9)
rectangle_3 = Rectangle(Plane=pln, XSize=dom_5, YSize=dom_6, Radius=0)  # -> Rectangle, Length
dom_10 = ConstructDomain(DomainStart=division_12, DomainEnd=neg_10)
dom_11 = ConstructDomain(DomainStart=division_13, DomainEnd=neg_11)
dom_12 = ConstructDomain(DomainStart=division_14, DomainEnd=neg_12)
num_2 = Number(bang_6.Branch2)
sdiff_2 = SolidDifference(BrepsA=sunion_2, BrepsB=boundary_2)
multiplication_13 = Multiplication(A="0.1", B=25.4)
offset = Offset(Curve=rectangle.Rectangle, Distance=multiplication_13, Plane=pln, Corners=1)
rectangle_4 = Rectangle(Plane=pln_2, XSize=dom_7, YSize=dom_8, Radius=0)  # -> Rectangle, Length
boundary_5 = BoundarySurfaces(Edges=rectangle.Rectangle)
mirror_2 = Mirror(Geometry=sdiff_2, Plane=pl_4)  # -> Geometry, Transform
boundary_6 = BoundarySurfaces(Edges=rectangle_2.Rectangle)
boundary_7 = BoundarySurfaces(Edges=rectangle_3.Rectangle)
rectangle_5 = Rectangle(Plane=pln_2, XSize=dom_9, YSize=dom_10, Radius=0)  # -> Rectangle, Length
boundary_8 = BoundarySurfaces(Edges=offset)
rectangle_6 = Rectangle(Plane=pln_2, XSize=dom_11, YSize=dom_12, Radius=0)  # -> Rectangle, Length
addition_5 = Addition(A=num, B=multiplication_13)
multiplication_14 = Multiplication(A="0.1", B=25.4)
offset_2 = Offset(Curve=rectangle_4.Rectangle, Distance=multiplication_14, Plane=pln_2, Corners=1)
Z_3 = UnitZ(Factor=num)
Z_4 = UnitZ(Factor=addition_5)
extr = Extrude(Base=[mirror.Geometry, sdiff], Direction=Z_4)
boundary_9 = BoundarySurfaces(Edges=rectangle_4.Rectangle)
boundary_10 = BoundarySurfaces(Edges=rectangle_5.Rectangle)
boundary_11 = BoundarySurfaces(Edges=rectangle_6.Rectangle)
boundary_12 = BoundarySurfaces(Edges=offset_2)
Z_5 = UnitZ(Factor=bang_4.Branch2)
Z_6 = UnitZ(Factor=bang_5.Branch2)
addition_6 = Addition(A=num_2, B=multiplication_14)
extr_2 = Extrude(Base=boundary_6, Direction=Z_5)
extr_3 = Extrude(Base=boundary_5, Direction=Z_3)
extr_4 = Extrude(Base=boundary_8, Direction=Z_4)
extr_5 = Extrude(Base=boundary_7, Direction=Z_6)
Z_7 = UnitZ(Factor=num_2)
Z_8 = UnitZ(Factor=addition_6)
extr_6 = Extrude(Base=[mirror_2.Geometry, sdiff_2], Direction=Z_8)
Z_9 = UnitZ(Factor=bang_7.Branch2)
Z_10 = UnitZ(Factor=bang_8.Branch2)
extr_7 = Extrude(Base=boundary_10, Direction=Z_9)
extr_8 = Extrude(Base=boundary_9, Direction=Z_7)
extr_9 = Extrude(Base=boundary_12, Direction=Z_8)
extr_10 = Extrude(Base=boundary_11, Direction=Z_10)
sunion_3 = SolidUnion(Breps=[extr_3, extr_2, extr_5])
sunion_4 = SolidUnion(Breps=[extr_8, extr_7, extr_10])
sdiff_3 = SolidDifference(BrepsA=extr_4, BrepsB=sunion_3)
sdiff_4 = SolidDifference(BrepsA=extr, BrepsB=sdiff_3)  # -> flatten(Result)
sdiff_5 = SolidDifference(BrepsA=extr_9, BrepsB=sunion_4)
sunion_5 = SolidUnion(Breps=flatten([sdiff_4, sdiff_3]))
sdiff_6 = SolidDifference(BrepsA=extr_6, BrepsB=sdiff_5)  # -> flatten(Result)
X_3 = UnitX(Factor="60")
move = Move(Geometry=sunion_5, Motion=X_3)  # -> Geometry, Transform
sunion_6 = SolidUnion(Breps=flatten([sdiff_6, sdiff_5]))
